% Simulink data dictionary SparkplugStateMachine.sldd

HostWill = Simulink.Signal(DataType="uint32", InitialValue="0")  % Will of the host
EoNWill = Simulink.Signal(DataType="uint32")

MQTT_PUBLISH_FLAGS = Simulink.Bus()
  RETAIN: boolean
  QOS: Enum: MQTT_QOS
  DUP: boolean  % MQTT 2.1.3 Flags

eQOS = enum(DefaultValue="Qos0", StorageType="uint8")  % not properly represented, as it's 2bits in a word, and this is a uint8 in length.
  Qos0 = 0
  Qos1 = 1
  Qos2 = 2

MqttPacket = Simulink.Bus()
  Type: Enum: MQTT_Packet_Type  % type of packet to send
  QOS: Enum: eQOS
  Will: uint32
  ConnectFlag: Bus: ConnectFlags
  KeepAlive: uint16
  SessionExpiry: uint32

ConnectFlags = Simulink.Bus()  % Doesnt include UserNameFlag, or PasswordFlag, or WillQoS.
  % See Will_QOS
  CleanStart: boolean
  WillFlag: boolean
  WillRetain: boolean

Session = Simulink.Bus()  % State Information
  KeepAliveDuration: double

MQTT_Packet_Type = enum(DefaultValue="TCP_ESTABLISHED", StorageType="uint8", AddClassNameToEnumNames=true)  % MQTT Version 5.0 packet types, section 2.1.2
  TCP_ESTABLISHED = 0  % Forbidden Value, yet used to indicate preciding tcp protocal dependence
  CONNECT = 1
  CONNACK = 2
  PUBLISH = 3
  PUBACK = 4
  PUBREC = 5
  PUBRREL = 6
  PUBCOMP = 7
  SUBSCRIBE = 8
  SUBACK = 9
  UNSUBSCRIBE = 10
  UNSUBACK = 11
  PINGREQ = 12
  PINGRESP = 13
  DISCONNECT = 14
  AUTH = 15